# Grasshopper definition ReadTxtFile.gh (Grasshopper 1.0.7)

# ---- group: the filePath of the .txt file
panel = Panel("/Users/tanzubin/Desktop/Studio/ExportPoint/ExportPoint.txt")

# ----
file = ReadFile(File=panel, PerLineParse=True)

split = TextSplit(Text=file, Separators=",")  # -> simplify(Result)
num = Number(split)
multiplication = Multiplication(A=num, B=1000)
item = ListItem(List=num, Index=0, Wrap=True)  # -> Item, Item1, Item2
pt = ConstructPoint(XCoordinate=item.Item, YCoordinate=item.Item1, ZCoordinate=item.Item2)  # -> flatten(Point)
panel_2 = Panel(pt)

item_2 = ListItem(List=pt, Index=Slider(99, range=0..99), Wrap=True)
box = CenterBox(Base=item_2, X=1, Y=1, Z=1)

pt_2 = Point(file)
pline = PolyLine(Vertices=pt_2, Closed=False)
